# Grasshopper definition main.gh (Grasshopper 1.0.8)
# plug-ins: RhinoCodePluginGH

# ---- group: RH_IN : zip file
zip_file = FilePath("C:\Users\bsh96\Desktop\EDDM\week5\37612010.zip")

# ----
vworld_shp_zip_to_3d_model = Python3Script(path=zip_file)  # -> out, contour_curves, terrain_mesh, building_breps, road_region_curves, road_centerline_curves; inputs path: String
# ---------- vworld_shp_zip_to_3d_model: Python ----------
# -*- coding:utf-8 -*-
from typing import List, Tuple, Optional
import zipfile
import shapefile
import Rhino.Geometry as geo
import ghpythonlib.components as ghcomp  # ignore

#########################
# bsh960flash@snu.ac.kr #
#########################


# Contour Divide Resolution(Higher value means more points in terrain mesh)
RESOLUTION = 4

# Shape type mapping
# This dictionary categorizes shape types based on their IDs as defined in the shapefile specification.
# The categories are 'point' and 'polyline', and the IDs represent different geometry types.
shape_types = {
    "point": [
        1,  # POINT
        8,  # MULTIPOINT
        11,  # POINTZ
        18,  # MULTIPOINTZ
        21,  # POINTM
        28,  # MULTIPOINTM
    ],
    "polyline": [
        3,  # POLYLINE
        5,  # POLYGON
        13,  # POLYLINEZ
        15,  # POLYGONZ
        23,  # POLYLINEM
        25,  # POLYGONM
        31,  # MULTIPATCH
    ],
}


class ShapefileHandler:
    """
    A class to manage Shapefile operations.
    """

    def __init__(self, zip_path: str):
        self.zip_path = zip_path
        self.zip_file = zipfile.ZipFile(zip_path, "r")

    def read_shapefile(self, file_prefixes: List[str]) -> Optional[shapefile.Reader]:
        """
        Attempts to read a shapefile from the zip archive using a list of prefixes.
        """
        for prefix in file_prefixes:
            try:
                return shapefile.Reader(
                    shp=self.zip_file.open(f"{prefix}.shp"),
                    shx=self.zip_file.open(f"{prefix}.shx"),
                    dbf=self.zip_file.open(f"{prefix}.dbf"),
                    prj=self.zip_file.open(f"{prefix}.prj"),
                )
            except KeyError:
                continue
        return None

    def extract_data(self, shapefile: shapefile.Reader) -> "ShpData":
        """
        Extracts data from a shapefile.
        """
        result = ShapefileParser.read_shapefile(shapefile)
        return ShpData(*result)


class ShpData:
    """
    A class to store Shapefile data.
    """

    def __init__(self, shape_type, geometry, fields, field_names, records):
        self.shape_type = shape_type
        self.geometry = geometry
        self.fields = fields
        self.field_names = field_names
        self.records = records


class ShapefileParser:
    """
    A class to handle parsing operations for shapefiles.
    """

    @staticmethod
    def find_type(shape_type):
        for key, values in shape_types.items():
            if shape_type in values:
                return key
        return None

    @staticmethod
    def read_shapefile(sf: shapefile.Reader, encoding="utf-8") -> Tuple:
        result_geom = []
        result_fields = []
        result_field_names = []
        result_records = []

        shape_type = ShapefileParser.find_type(sf.shapeType)

        # Extract field names
        for field in sf.fields:
            if field[0] != "DeletionFlag":
                _field = field[0]
                if isinstance(_field, bytes):
                    _field = _field.decode(encoding, errors="replace")
                result_field_names.append(_field)
                result_fields.append(field)

        # Extract geometry and records
        for shape, record in zip(sf.shapes(), sf.records()):
            geom = ShapefileParser.parse_geometry(shape, shape_type)
            result_geom.append(geom)
            _record = []
            for rec in record:
                if isinstance(rec, bytes):
                    _record.append(rec.decode(encoding, errors="replace"))
                else:
                    _record.append(rec)
            result_records.append(_record)

        return (
            shape_type,
            result_geom,
            result_fields,
            result_field_names,
            result_records,
        )

    @staticmethod
    def parse_geometry(shape, shape_type):
        if shape_type == "point":
            return [GeometryUtils.list2point(pt) for pt in shape.points]
        elif shape_type == "polyline":
            parts = [
                shape.points[
                    shape.parts[i] : (
                        shape.parts[i + 1] if i + 1 < len(shape.parts) else None
                    )
                ]
                for i in range(len(shape.parts))
            ]
            return [
                geo.PolylineCurve([GeometryUtils.list2point(pt) for pt in part])
                for part in parts
            ]
        return []


class GeometryUtils:
    """
    A utility class for geometry-related operations.
    """

    @staticmethod
    def list2point(pts):
        pts = list(pts)
        if len(pts) == 2:
            pts.append(0)
        return geo.Point3d(*pts)

    @staticmethod
    def get_vertices(curve):
        vertices = [
            curve.PointAt(curve.SpanDomain(i)[0]) for i in range(curve.SpanCount)
        ]
        if not curve.IsClosed:
            vertices.append(curve.PointAtEnd)
        return vertices

    @staticmethod
    def get_projected_pt_on_mesh(pt, mesh):
        for direction in [geo.Vector3d(0, 0, -1), geo.Vector3d(0, 0, 1)]:
            ray = geo.Ray3d(pt, direction)
            t = geo.Intersect.Intersection.MeshRay(mesh, ray)
            if t >= 0:
                return ray.PointAt(t)
        return None


class ContourProcessor:
    """
    A class to handle contour operations.
    """

    @staticmethod
    def create_contour_curves(contour_geometry_records):
        contour_crvs = []
        for contour_geom, contour_record in contour_geometry_records:
            contour_crvs.append(
                geo.PolylineCurve(
                    [
                        geo.Point3d(
                            contour_geom[0].Point(pt_count).X,
                            contour_geom[0].Point(pt_count).Y,
                            contour_record[1],
                        )
                        for pt_count in range(contour_geom[0].SpanCount)
                    ]
                )
            )
        return contour_crvs

    @staticmethod
    def create_points_for_mesh(contour_curves, resolution):
        points = []
        for curve in contour_curves:
            params = curve.DivideByLength(resolution, True)
            if params:
                points.extend([curve.PointAt(param) for param in params])
        return points


class BuildingProcessor:
    """
    A class to process building geometries.
    """

    @staticmethod
    def create_building_breps(building_geometry_records, mesh_terrain):
        breps = []
        for geom, record in building_geometry_records:
            base_curve = geom[0]
            height = record[5] * 3.5
            vertices = GeometryUtils.get_vertices(base_curve)

            projected_pts = [
                GeometryUtils.get_projected_pt_on_mesh(pt, mesh_terrain)
                for pt in vertices
            ]
            projected_pts = list(filter(None, projected_pts))

            if projected_pts:
                min_z = min(pt.Z for pt in projected_pts)
                base_curve.Translate(geo.Vector3d(0, 0, min_z - vertices[0].Z))
                breps.append(geo.Extrusion.Create(base_curve, -height, True))
        return breps


# path -> parameter of the component in grasshopper that is the path to the zip file

# Main workflow
handler = ShapefileHandler(path)

# V-World에서는 가끔 축척에 맞지 않는 네이밍으로 파일이름을 만들때가 있다.....
contour_shape = handler.read_shapefile(["N1L_F0010000", "N3L_F0010000"])
building_shape = handler.read_shapefile(["N1A_B0010000", "N3A_B0010000"])
road_region_shape = handler.read_shapefile(["N3A_A0010000", "N1A_A0010000"])
road_centerline_shape = handler.read_shapefile(["N3L_A0020000", "N1L_A0020000"])

# Extract data
contour_data = handler.extract_data(contour_shape)
building_data = handler.extract_data(building_shape)
road_region_data = handler.extract_data(road_region_shape)
road_centerline_data = handler.extract_data(road_centerline_shape)

# Process contour
contour_geometry_records = list(zip(contour_data.geometry, contour_data.records))
contour_curves = ContourProcessor.create_contour_curves(contour_geometry_records)

# Process terrain
mesh_points = ContourProcessor.create_points_for_mesh(contour_curves, RESOLUTION)
terrain_mesh = ghcomp.DelaunayMesh(mesh_points)

# Process buildings
building_geometry_records = list(zip(building_data.geometry, building_data.records))
building_breps = BuildingProcessor.create_building_breps(
    building_geometry_records, terrain_mesh
)

# Process road
road_region_curves = [data[0] for data in road_region_data.geometry]
road_centerline_curves = [data[0] for data in road_centerline_data.geometry]

print (type(road_region_curves))
print (type(road_region_curves[0]))
# ---------- end vworld_shp_zip_to_3d_model ----------

# ---- group: RH_OUT : road_centerline_curves
crv = Curve(vworld_shp_zip_to_3d_model.road_centerline_curves)

# ---- group: RH_OUT : building_breps
brep = Brep(vworld_shp_zip_to_3d_model.building_breps)

# ---- group: RH_OUT : contour_curves
crv_2 = Curve(vworld_shp_zip_to_3d_model.contour_curves)

# ---- group: RH_OUT : terrain_mesh
mesh = Mesh(vworld_shp_zip_to_3d_model.terrain_mesh)

# ---- group: RH_OUT : road_region_curves
crv_3 = Curve(vworld_shp_zip_to_3d_model.road_region_curves)
